# Dynamo graph Bulk Revision_script.dyn "Bulk Revision" (Dynamo 2.3.1.11775)
# packages: Data-Shapes 2022.2.96, Crumple 2021.8.4

# group: About the script
# note: Script to support Aussie BIM Guru / Nonica toolbar for Revit. Built and tested in Dynamo 2.3.0 and Revit 2020. Free for personal/company use but not to be used for resale or directly derived profit.
# Package dependcies shown above all nodes.
# note: Bulk applies revisions to sheets (can either add or remove from each one).
# note: G'day there, you can find my channel here:
# www.youtube.com/aussiebimguru
# Keep on scriptin'!

# group: Revision Dropdown
code_block = CodeBlock { "SELECT REVISION"; 0; false; }
code_block_2 = CodeBlock { "Revision"; }
# note: Custom Node: Crumple v.2021.8.4
elementtypebyname = Custom[© ElementTypeByName](name=code_block_2)  # package Crumple; Given an element type name, if it finds a match it will return that element type.
all_elements_of_type = ElementsOfType(element_type=elementtypebyname)
name = Element.Name(element=all_elements_of_type)
# note: Custom Node: Data-Shapes v.2022.2.96
dropdown_data = Custom[DropDown Data](InputName=code_block.out0, Keys=name, Values=all_elements_of_type, DefaultValueIndex=code_block.out1, Sorted_optional=code_block.out2)  # package Data-Shapes; Create data for DropDown input in UI.MultiInputForm ++ . Check out www.data-shapes.net for more infos.

# group: Sheets Listview
code_block_3 = CodeBlock { "SELECT SHEETS"; 300; true; false; }
code_block_4 = CodeBlock { "Sheets"; }
byName = Category.ByName(name=code_block_4)
all_elements_of_category = ElementsOfCategory(Category=byName)
sheetNumber = Sheet.SheetNumber(sheet=all_elements_of_category)
sheetName = Sheet.SheetName(sheet=all_elements_of_category)
code_block_5 = CodeBlock(nu=sheetNumber, na=sheetName) { nu + ": " +na; }
# note: Custom Node: Data-Shapes v.2022.2.96
listview_data = Custom[Listview Data](InputName=code_block_3.out0, Keys=code_block_5, Values=all_elements_of_category, Height_optionnal=code_block_3.out1, HilightInView_optionnal=code_block_3.out3, DisplayModeOnly_optionnal=code_block_3.out3, ShowElementCount_optionnal=code_block_3.out3, SortItems_optionnal=code_block_3.out2)  # package Data-Shapes; Create data for ListView input in UI.MultiInputForm ++ . Check out www.data-shapes.net for more infos.

# group: Action radio buttons
code_block_6 = CodeBlock { "ACTION"; ["ADD","REMOVE"]; [true,false]; 0; }
# note: Custom Node: Data-Shapes v.2022.2.96
radiobuttons_data = Custom[RadioButtons Data](InputName=code_block_6.out0, Keys=code_block_6.out1, Values=code_block_6.out2, DefaultValueIndex=code_block_6.out3)  # package Data-Shapes; Create radio buttons input for UI.MultipleInputForm ++ .

# group: Main user interface
list_create = List.Create(item0=dropdown_data, item1=listview_data, item2=radiobuttons_data)
code_block_7 = CodeBlock(inputs=list_create) { "ADD OR REMOVE REVISIONS"; "RUN"; inputs; true; "CANCEL"; 900; 600; 150; }
# note: Custom Node: Crumple v.2021.8.4
uilogopath = Custom[© UILogoPath]()  # package Crumple; Returns the file path of your 'My Documents' folder, then the file 'logo.png'. If you store your logo here you can call on it reliably for Data Shapes interfaces.
# note: Custom Node: Data-Shapes v.2022.2.96
multipleinputform = Custom[MultipleInputForm ++](Description_optional=code_block_7.out0, Logo_optional=uilogopath, ButtonText_optional=code_block_7.out1, Inputs=code_block_7.inputs, Toggle=code_block_7.out3, CancelButtonText_optional=code_block_7.out4, MaxHeight_optional=code_block_7.out5, Width_optional=code_block_7.out6, LabelWidth_optional=code_block_7.out7)  # package Data-Shapes; Create a form with multiple inputs. see www.data-shapes.net for tutorials and infos!

# group: Add/remove
code_block_8 = CodeBlock(data=multipleinputform.User_Inputs) { rev = data[0]; sht = data[1]; add = data[2]; }
# note: Custom Node: Crumple v.2021.8.4
sheetaddrevisions = Custom[© SheetAddRevisions](sheets=code_block_8.sht, revisions=code_block_8.rev, runMe=code_block_8.add)  # package Crumple; Given a list of sheets, attempt to add the given revisions to each of those sheets.
not_ = Not(x=code_block_8.add)
sheetremoverevisions = Custom[© SheetRemoveRevisions](sheets=code_block_8.sht, revisions=code_block_8.rev, runMe=not_)  # package Crumple; Given a list of sheets, attempt to remove given revisions from those sheets.

# group: Display outcome interface
code_block_9 = CodeBlock { " added to "; " removed from "; }
if_ = If(test=code_block_8.add, true=code_block_9.out0, false=code_block_9.out1)
count = List.Count(list=code_block_8.sht)
code_block_10 = CodeBlock(action=if_, n=count) { "OUTCOME"; "Revision" + action + n + " sheets."; }
# note: Custom Node: Crumple v.2021.8.4
uimessenger = Custom[© UIMessenger](title=code_block_10.out0, body=code_block_10.out1)  # package Crumple; Displays a message box with a title/body and OK/cancel button. If OK is selected, the third input's data will be passed through.
